# Grasshopper definition kiss_battery_data_input.gh (Grasshopper 1.0.7)
# plug-ins: Squid (ShapeDiver Edition), ShapeDiver

file_path = FilePath("C:\Users\PETA-Anwender\Desktop\KISS Demo\input1.json")
file_path_2 = FilePath("C:\Users\PETA-Anwender\Desktop\KISS Demo\input2.json")
panel = Panel(file_path_2)
panel_2 = Panel(file_path)
json = PythonScript(FilePath=file_path_2)  # -> out
# ---------- json: Python ----------
import json

if FilePath:
    
    # JSON file to read
    file = open(FilePath)
    
    # Load the data
    data = json.load(file)
    
    # Do something with the data
    print data
# ---------- end json ----------

panel_3 = Panel(json)
shapediverjsonparse = ShapeDiverJSONParse(JSON=json)
shapediverjsonaccess = ShapeDiverJSONAccess(Object=shapediverjsonparse, AddressString="data")
panel_4 = Panel(shapediverjsonaccess)

# ----
# Dicke der Grundplatte
# ohne Kühlkanal
number_slider = Slider(2, range=0..10)

# ----
# Anzahl der Pouchzellen
number_slider_2 = Slider(8, range=0..10)

shapediverjsonaccess_2 = ShapeDiverJSONAccess(Object=shapediverjsonaccess, AddressString="t_wall")
shapediverjsonaccess_3 = ShapeDiverJSONAccess(Object=shapediverjsonaccess, AddressString="nracks")
shapediverjsonaccess_4 = ShapeDiverJSONAccess(Object=shapediverjsonaccess, AddressString="channel_width")
shapediverjsonaccess_5 = ShapeDiverJSONAccess(Object=shapediverjsonaccess, AddressString="t_baseplate_without_channel")
shapediverjsonaccess_6 = ShapeDiverJSONAccess(Object=shapediverjsonaccess, AddressString="ncells")
shapediverjsonaccess_7 = ShapeDiverJSONAccess(Object=shapediverjsonaccess, AddressString="channel_height")
shapediverjsonaccess_8 = ShapeDiverJSONAccess(Object=shapediverjsonaccess, AddressString="t_endplate")
shapediverjsonaccess_9 = ShapeDiverJSONAccess(Object=shapediverjsonaccess, AddressString="assy_id")
panel_5 = Panel(shapediverjsonaccess_6)
panel_6 = Panel(shapediverjsonaccess_2)
panel_7 = Panel(shapediverjsonaccess_3)
panel_8 = Panel(shapediverjsonaccess_4)
panel_9 = Panel(shapediverjsonaccess_5)

# ----
# GRUNDPLATTE OHNE KUEHLKANAL
fräsbauteil_2 = Brep(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)
multiplication = Multiplication(A=panel_5, B="46.375")
rectangle = Rectangle(Plane=PlaneXY(0, 0, 0), XSize=multiplication, YSize=Slider(180, range=0..1000), Radius=Slider(10, range=0..10))  # -> Rectangle, Length
vec = VectorXYZ(XComponent=0, YComponent=0, ZComponent=panel_9)  # -> Vector, Length
extr = Extrude(Base=rectangle.Rectangle, Direction=vec.Vector)
cap = CapHoles(Brep=extr)

# ----
# R1
# R2
number_slider_3 = Slider(7, range=0..20)
circle = CircleCNR(Center="{-8, 150, 0}", Normal=Vector(0, 0, 1), Radius=Slider(4, range=0..20))
addition = Addition(A=Slider(12, range=0..100), B=panel_9)
addition_2 = Addition(A=Slider(20, range=0..100), B=panel_9)
addition_3 = Addition(A=Slider(-20, range=-20..100), B=panel_9)
circle_2 = CircleCNR(Center="{-5, 130, 0}", Normal=Vector(0, 0, 1), Radius=Slider(3, range=0..20))
circle_3 = CircleCNR(Center="{-5, 130, 0}", Normal=Vector(0, 0, 1), Radius=number_slider_3)
circle_4 = CircleCNR(Center="{-8, 150, 0}", Normal=Vector(0, 0, 1), Radius=Slider(11, range=0..20))
vec_2 = VectorXYZ(XComponent=0, YComponent=0, ZComponent=addition_3)  # -> Vector, Length
vec_3 = VectorXYZ(XComponent=0, YComponent=0, ZComponent=addition_2)  # -> Vector, Length
vec_4 = VectorXYZ(XComponent=0, YComponent=0, ZComponent=addition)  # -> Vector, Length
extr_2 = Extrude(Base=[circle_4, circle, circle_3], Direction=vec_4.Vector)
extr_3 = Extrude(Base=[circle, circle_2], Direction=vec_3.Vector)
extr_4 = Extrude(Base=[circle, circle_2], Direction=vec_2.Vector)
cap_2 = CapHoles(Brep=extr_2)
cap_3 = CapHoles(Brep=[extr_4, extr_3])
xz = XZPlane(Origin="{0, 90, 0}")
sunion = SolidUnion(Breps=cap_3)
trim = TrimSolid(Shape=cap_2, Cutters=sunion)
division = Division(A=multiplication, B=Slider(2, range=0..10))
vec_5 = VectorXYZ(XComponent=division, YComponent=0, ZComponent=0)  # -> Vector, Length
mirror = Mirror(Geometry=trim, Plane=xz)  # -> Geometry, Transform
yz = YZPlane(Origin=vec_5.Vector)
mirror_2 = Mirror(Geometry=[mirror.Geometry, trim], Plane=yz)  # -> Geometry, Transform

pl_offset = PlaneOffset(BasePlane=PlaneXY(0, 0, 0), Offset=panel_9)
addition_4 = Addition(A=panel_5, B=Slider(1, range=0..1))
series = Series(Start=0, Step=1, Count=addition_4)
rec_2pt = Rectangle2Pt(Plane=pl_offset, PointA="{0, 19, 0}", PointB="{3, 161, 0}", Radius=Slider(1, range=0..1))  # -> Rectangle, Length
rec_2pt_2 = Rectangle2Pt(Plane=pl_offset, PointA="{12, 164, 0}", PointB="{37, 161, 0}", Radius=Slider(1, range=0..1))  # -> Rectangle, Length
number_slider_4 = Slider(46, range=0..100)
multiplication_2 = Multiplication(A=number_slider_4, B=series)
vec_6 = VectorXYZ(XComponent=[multiplication_2, number_slider_4], YComponent=0, ZComponent=0)  # -> Vector, Length
extr_5 = Extrude(Base=rec_2pt.Rectangle, Direction="{0, 0, 5}")
cap_4 = CapHoles(Brep=extr_5)
move = Move(Geometry=cap_4, Motion=vec_6.Vector)  # -> Geometry, Transform

series_2 = Series(Start=0, Step=1, Count=panel_5)
number_slider_5 = Slider(46, range=0..100)
multiplication_3 = Multiplication(A=number_slider_5, B=series_2)
extr_6 = Extrude(Base=rec_2pt_2.Rectangle, Direction="{0, 0, 5}")
vec_7 = VectorXYZ(XComponent=[multiplication_3, number_slider_5], YComponent=0, ZComponent=0)  # -> Vector, Length
cap_5 = CapHoles(Brep=extr_6)
move_2 = Move(Geometry=cap_5, Motion=vec_7.Vector)  # -> Geometry, Transform

panel_10 = Panel(shapediverjsonaccess_7)
panel_11 = Panel(shapediverjsonaccess_9)
panel_12 = Panel(shapediverjsonaccess_8)
addition_5 = Addition(A=panel_10, B=panel_6)
thickness_baseplate_with_cooling_channel = Panel(addition_5)

# ----
# Wandstärke des Kühlkanals
# zur Pouchzelle
wandstärke = Slider(1, range=0..10)

# ----
# Breite Kühlkanal
breite = Slider(20, range=1..30)

# ----
# Tiefe Kühlkanal
tiefe = Slider(2, range=0..20)

# ----
# Mutter Verschraubung
number_slider_6 = Slider(6, range=0..25)
polygon = Polygon(Plane="{-5, 130, 0}", Radius=Slider(5.5, range=0..25), Segments=number_slider_6, FilletRadius=0)  # -> Polygon, Length
circle_cnr = CircleCNR(Center="{-5, 130, -4}", Normal=Vector(0, 0, 1), Radius=Slider(4.6, range=0..10))
vector_xyz = VectorXYZ(XComponent=0, YComponent=0, ZComponent=Slider(5, range=0..15))  # -> Vector, Length
vector_xyz_2 = VectorXYZ(XComponent=0, YComponent=0, ZComponent=Slider(4, range=0..25))  # -> Vector, Length
reverse = Reverse(Vector=vector_xyz.Vector)
reverse_2 = Reverse(Vector=vector_xyz_2.Vector)
extrude = Extrude(Base=circle_cnr, Direction=reverse)
extrude_2 = Extrude(Base=polygon.Polygon, Direction=reverse_2)
value_list = ValueList({"Fillet": 0, "Chamfer": 1, "Blend": 2}, selected="Fillet")
cap_holes = CapHoles(Brep=extrude)
cap_holes_2 = CapHoles(Brep=extrude_2)
deconstruct_brep = DeconstructBrep(Brep=cap_holes)  # -> Faces, Edges, Vertices
fillet_edge = FilletEdge(Shape=cap_holes, Blend=value_list, Metric=Slider(0, range=0..1), Edges=1, Radii=Slider(4.5, range=0..10))
point_on_curve = PointOnCurve(deconstruct_brep.Edges, parameter=0.5)
point_list = PointList(Points=point_on_curve, Size=Slider(0.5, range=0..5))
solid_union = SolidUnion(Breps=[cap_holes_2, fillet_edge])

# ----
# Verschraubung
panel_13 = Panel("{-5, 130, 0}")
vector_xyz_3 = VectorXYZ(XComponent=0, YComponent=0, ZComponent=Slider(36, range=0..500))  # -> Vector, Length
# Anbauteile
circle_cnr_2 = CircleCNR(Center=panel_13, Normal=Vector(0, 0, 1), Radius=Slider(3, range=0..10))
extrude_3 = Extrude(Base=circle_cnr_2, Direction=vector_xyz_3.Vector)
cap_holes_3 = CapHoles(Brep=extrude_3)

# ----
# Verschluss Kühlkanal
number_slider_7 = Slider(4, range=0..10)
vector_xyz_4 = VectorXYZ(XComponent=0, YComponent=0, ZComponent=Slider(8, range=0..25))  # -> Vector, Length
vector_xyz_5 = VectorXYZ(XComponent=0, YComponent=0, ZComponent=Slider(5.3, range=0..25))  # -> Vector, Length
circle_cnr_3 = CircleCNR(Center="{-8, 150, 0}", Normal=Vector(0, 0, 1), Radius=number_slider_7)
polygon_2 = Polygon(Plane="{-8, 150, 0}", Radius=Slider(7, range=0..25), Segments=Slider(6, range=0..25), FilletRadius=0)  # -> Polygon, Length
extrude_4 = Extrude(Base=circle_cnr_3, Direction=vector_xyz_4.Vector)
reverse_3 = Reverse(Vector=vector_xyz_5.Vector)
extrude_5 = Extrude(Base=polygon_2.Polygon, Direction=reverse_3)
cap_holes_4 = CapHoles(Brep=extrude_4)
cap_holes_5 = CapHoles(Brep=extrude_5)
value_list_2 = ValueList({"Fillet": 0, "Chamfer": 1, "Blend": 2}, selected="Chamfer")
sunion_2 = SolidUnion(Breps=[cap_holes_5, cap_holes_4])
deconstruct_brep_2 = DeconstructBrep(Brep=sunion_2)  # -> Faces, Edges, Vertices
fillet_edge_2 = FilletEdge(
    Shape=sunion_2,
    Blend=value_list_2,
    Metric=Slider(0, range=0..1),
    Edges=[1, 3, 4, 8, 10, 11, 12],
    Radii=Slider(1, range=0..10))
point_on_curve_2 = PointOnCurve(deconstruct_brep_2.Edges, parameter=0.5)
point_list_2 = PointList(Points=point_on_curve_2, Size=Slider(0.5, range=0..5))
solid_union_2 = SolidUnion(Breps=fillet_edge_2)

# ----
# Dicke der Abschlussplatte
number_slider_8 = Slider(2, range=0..10)

# ----
# ABSCHLUSSPLATTE
# Verschraubung
# R1
# R2
panel_14 = Panel("5")
division_2 = Division(A="150", B=panel_14)
pt = ConstructPoint(XCoordinate="-8", YCoordinate=division_2, ZCoordinate=0)
pt_2 = ConstructPoint(XCoordinate="-8", YCoordinate="150", ZCoordinate=0)
multiplication_4 = Multiplication(A=panel_5, B="46.375")
abschlussplatte = Brep(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)
rectangle_2 = Rectangle(Plane=PlaneXY(0, 0, 0), XSize=multiplication_4, YSize=Slider(180, range=0..1000), Radius=Slider(10, range=0..10))  # -> Rectangle, Length
vec_8 = VectorXYZ(XComponent=0, YComponent=0, ZComponent=panel_12)  # -> Vector, Length
circle_5 = CircleCNR(Center="{-5, 130, 0}", Normal=Vector(0, 0, 1), Radius=Slider(7, range=0..20))
circle_6 = CircleCNR(Center="{-5, 130, 0}", Normal=Vector(0, 0, 1), Radius=Slider(3, range=0..20))
circle_7 = CircleCNR(Center=pt_2, Normal=Vector(0, 0, 1), Radius=Slider(4, range=0..20))
circle_8 = CircleCNR(Center="{-8, 150, 0}", Normal=Vector(0, 0, 1), Radius=Slider(11, range=0..20))
addition_6 = Addition(B=panel_12)
addition_7 = Addition(B=panel_12)
addition_8 = Addition(B=panel_12)
vec_9 = VectorXYZ(XComponent=0, YComponent=0, ZComponent=addition_7)  # -> Vector, Length
vec_10 = VectorXYZ(XComponent=0, YComponent=0, ZComponent=addition_6)  # -> Vector, Length
vec_11 = VectorXYZ(XComponent=0, YComponent=0, ZComponent=addition_8)  # -> Vector, Length
extr_7 = Extrude(Base=rectangle_2.Rectangle, Direction=vec_8.Vector)
extr_8 = Extrude(Base=[circle_8, circle_5], Direction=vec_10.Vector)
cap_6 = CapHoles(Brep=extr_7)
rev = Reverse(Vector=vec_9.Vector)
extr_9 = Extrude(Base=[circle_7, circle_6], Direction=graft([vec_9.Vector, rev]))
extr_10 = Extrude(Base=[circle_7, circle_6], Direction=graft([vec_11.Vector, rev]))
cap_7 = CapHoles(Brep=[extr_10, extr_9])
cap_8 = CapHoles(Brep=extr_8)
pt_3 = ConstructPoint(XCoordinate=0, YCoordinate="90", ZCoordinate=0)
sunion_3 = SolidUnion(Breps=cap_7)  # -> flatten(Result)
xz_2 = XZPlane(Origin=pt_3)
sdiff = SolidDifference(BrepsA=cap_8, BrepsB=sunion_3)
division_3 = Division(A=multiplication_4, B=Slider(2, range=0..10))
mirror_3 = Mirror(Geometry=sdiff, Plane=xz_2)  # -> Geometry, Transform
vec_12 = VectorXYZ(XComponent=division_3, YComponent=0, ZComponent=0)  # -> Vector, Length
yz_2 = YZPlane(Origin=vec_12.Vector)
mirror_4 = Mirror(Geometry=[mirror_3.Geometry, sdiff], Plane=yz_2)  # -> Geometry, Transform
sunion_4 = SolidUnion(Breps=cap_6)

# ----
# Anzahl der Module
number_slider_9 = Slider(9, range=0..10)

xy_plane = XYPlane(Origin=Point(0, 0, 0))
mirror_5 = Mirror(Plane=xy_plane)  # -> Geometry, Transform
vector_xyz_6 = VectorXYZ(XComponent=0, YComponent=0, ZComponent=0)  # -> Vector, Length
panel_15 = Panel(vector_xyz_6.Vector)
move_3 = Move(Geometry=mirror_5.Geometry, Motion=vector_xyz_6.Vector)  # -> Geometry, Transform
solid_union_3 = SolidUnion(Breps=move_3.Geometry)

# ----
# VISUALISIERUNG
# Verschluss Kühlkanal
# Pouchzellen
# Abschlussplatte
# Grundplatte ohne Kanal
# Verschraubung
# Mutter Verschraubung
# Grundplatte mit Kanal
# BMS
panel_16 = Panel("white")
material = CreateMaterial(Diffuse=panel_16, Specular=RGB(255, 255, 255), Emission=RGB(0, 0, 0), Transparency=0, Shine=0)
material_2 = CreateMaterial(Diffuse="119,136,153", Specular=RGB(255, 255, 255), Emission=RGB(0, 0, 0), Transparency=0, Shine=0)
material_3 = CreateMaterial(Diffuse="192,192,192", Specular=RGB(255, 255, 255), Emission=RGB(0, 0, 0), Transparency=0, Shine=0)
material_4 = CreateMaterial(Diffuse="255,250,200", Specular=RGB(255, 255, 255), Emission=RGB(0, 0, 0), Transparency=0, Shine=0)
material_5 = CreateMaterial(
    Diffuse="lightblue",
    Specular=RGB(255, 255, 255),
    Emission=RGB(0, 0, 0),
    Transparency=Slider(0, range=0..1),
    Shine=Slider(68, range=0..100))
material_6 = CreateMaterial(
    Diffuse="orange",
    Specular=RGB(255, 255, 255),
    Emission=RGB(0, 0, 0),
    Transparency=Slider(0, range=0..1),
    Shine=Slider(68, range=0..100))
material_7 = CreateMaterial(
    Diffuse="180,120,150",
    Specular=RGB(255, 255, 255),
    Emission=RGB(0, 0, 0),
    Transparency=Slider(0, range=0..1),
    Shine=Slider(68, range=0..100))
material_8 = CreateMaterial(
    Diffuse="lightgreen",
    Specular=RGB(255, 255, 255),
    Emission=RGB(0, 0, 0),
    Transparency=Slider(0, range=0..1),
    Shine=Slider(68, range=0..100))

# ----
# Demo Platte mit Kühlkanal
transparency = Slider(0, range=0..1)
shine = Slider(5, range=0..10)
create_material = CreateMaterial(Diffuse="119,136,153", Specular=RGB(255, 255, 255), Emission=RGB(0, 0, 0), Transparency=transparency, Shine=shine)

# ----
# Cut Out
number_slider_10 = Slider(50, range=0..1000)
vec_13 = VectorXYZ(XComponent=number_slider_10, YComponent=Slider(200, range=0..1000), ZComponent=0)  # -> Vector, Length
vec_14 = VectorXYZ(XComponent=0, YComponent=0, ZComponent=Slider(100, range=0..100))  # -> Vector, Length
vec_15 = VectorXYZ(XComponent=0, YComponent=0, ZComponent=Slider(100, range=0..100))  # -> Vector, Length
rev_2 = Reverse(Vector=vec_14.Vector)

font = Font(Family="Arial", Size="6", Bold=False, Italic=Toggle(True), Underline=False)
unit_z = UnitZ(Factor=" 0.1")
yz_plane = YZPlane(Origin=Point(0, 0, 0))
create_material_2 = CreateMaterial(Diffuse="210,100,100", Specular=RGB(255, 255, 255), Emission=RGB(0, 0, 0), Transparency=0, Shine=0)

# ----
# CAD
sunion_5 = SolidUnion(Breps=[cap, move.Geometry, move_2.Geometry])
merge = Merge(Data1=sunion_5, Data2=mirror_2.Geometry, Data3=mirror.Geometry, Data4=trim)
pi = Pi(Factor=1)
xz_3 = XZPlane(Origin=Point(0, 0, 0))
rot3d = Rotate3D(Geometry=merge, Angle=pi, Center=Point(0, 0, 0), Axis=xz_3)  # -> Geometry, Transform

# ----
# Verschraubung
# R1
# R2
panel_17 = Panel("-8")
construct_point = ConstructPoint(XCoordinate=panel_17, YCoordinate="150", ZCoordinate=0)
division_4 = Division(A="150", B="5")
pt_4 = ConstructPoint(XCoordinate="10", YCoordinate="150", ZCoordinate=0)  # -> graft(Point)
pt_5 = ConstructPoint(XCoordinate="10", YCoordinate=division_4, ZCoordinate=0)
circle_9 = CircleCNR(Center="{-5, 130, 0}", Normal=Vector(0, 0, 1), Radius=Slider(7, range=0..20))
circle_10 = CircleCNR(Center="{-5, 130, 0}", Normal=Vector(0, 0, 1), Radius=Slider(3, range=0..20))
circle_11 = CircleCNR(Center=construct_point, Normal=Vector(0, 0, 1), Radius=Slider(4, range=0..20))
circle_12 = CircleCNR(Center="{-8, 150, 0}", Normal=Vector(0, 0, 1), Radius=Slider(11, range=0..20))
pt_6 = ConstructPoint(XCoordinate=0, YCoordinate="90", ZCoordinate=0)
xz_4 = XZPlane(Origin=pt_6)

# ----
# GRUNDPLATTE MIT KUEHLKANAL
addition_9 = Addition(A=panel_6, B=panel_10)
multiplication_5 = Multiplication(A=panel_5, B="46.375")
rectangle_3 = Rectangle(Plane=PlaneXY(0, 0, 0), XSize=multiplication_5, YSize=Slider(180, range=0..1000), Radius=Slider(10, range=0..10))  # -> Rectangle, Length
vec_16 = VectorXYZ(XComponent=0, YComponent=0, ZComponent=addition_9)  # -> Vector, Length
extr_11 = Extrude(Base=rectangle_3.Rectangle, Direction=vec_16.Vector)
cap_9 = CapHoles(Brep=extr_11)

subtraction = Subtraction(A=multiplication_5, B=number_slider_10)
vec_17 = VectorXYZ(XComponent=subtraction, YComponent=Slider(168, range=0..1000), ZComponent=0)  # -> Vector, Length
rec_2pt_3 = Rectangle2Pt(Plane=PlaneXY(0, 0, 0), PointA=vec_13.Vector, PointB=vec_17.Vector, Radius=Slider(5, range=0..10))  # -> Rectangle, Length
mirror_6 = Mirror(Geometry=rec_2pt_3.Rectangle, Plane=xz_4)  # -> Geometry, Transform
extr_12 = Extrude(Base=[mirror_6.Geometry, rec_2pt_3.Rectangle], Direction=graft([rev_2, vec_15.Vector]))
cap_10 = CapHoles(Brep=extr_12)

vec_18 = VectorXYZ(XComponent=multiplication_5, YComponent=0, ZComponent=0)  # -> Vector, Length
move_4 = Move(Geometry=rot3d.Geometry, Motion=vec_18.Vector)  # -> Geometry, Transform
sdiff_2 = SolidDifference(BrepsA=graft(move_4.Geometry), BrepsB=flatten(cap_10))

# ----
# Cut Out
number_slider_11 = Slider(200, range=0..1000)
number_slider_12 = Slider(50, range=0..1000)
subtraction_2 = Subtraction(A=multiplication_5, B=number_slider_12)
vec_19 = VectorXYZ(XComponent=number_slider_12, YComponent=number_slider_11, ZComponent=0)  # -> Vector, Length
vec_20 = VectorXYZ(XComponent=subtraction_2, YComponent=Slider(168, range=0..1000), ZComponent=0)  # -> Vector, Length
rec_2pt_4 = Rectangle2Pt(Plane=PlaneXY(0, 0, 0), PointA=vec_19.Vector, PointB=vec_20.Vector, Radius=Slider(5, range=0..10))  # -> Rectangle, Length
mirror_7 = Mirror(Geometry=rec_2pt_4.Rectangle, Plane=xz_4)  # -> Geometry, Transform
vec_21 = VectorXYZ(XComponent=0, YComponent=0, ZComponent=Slider(100, range=0..100))  # -> Vector, Length
vec_22 = VectorXYZ(XComponent=0, YComponent=0, ZComponent=Slider(100, range=0..100))  # -> Vector, Length
rev_3 = Reverse(Vector=vec_21.Vector)
extr_13 = Extrude(Base=[mirror_7.Geometry, rec_2pt_4.Rectangle], Direction=graft([rev_3, vec_22.Vector]))
cap_11 = CapHoles(Brep=extr_13)

# ----
# Mittellinien Kühlkanal
# Abstand  der Bögen zur Außenwand
number_slider_13 = Slider(50, range=0..100)
subtraction_3 = Subtraction(A="150", B=division_4)
integer_division = IntegerDivision(A=subtraction_3, B="3")
subtraction_4 = Subtraction(A="150", B=integer_division)
subtraction_5 = Subtraction(A=subtraction_4, B=integer_division)
subtraction_6 = Subtraction(A=multiplication_5, B=number_slider_13)
pt_7 = ConstructPoint(XCoordinate=subtraction_6, YCoordinate=subtraction_4, ZCoordinate=0)  # -> flatten(Point)
pt_8 = ConstructPoint(XCoordinate=number_slider_13, YCoordinate=subtraction_4, ZCoordinate=0)
pt_9 = ConstructPoint(XCoordinate=number_slider_13, YCoordinate=subtraction_5, ZCoordinate=0)  # -> graft(Point)
pt_10 = ConstructPoint(XCoordinate=subtraction_6, YCoordinate=subtraction_5, ZCoordinate=0)
vec_23 = VectorXYZ(XComponent=subtraction_6, YComponent=0, ZComponent=0)  # -> Vector, Length
pt_11 = ConstructPoint(XCoordinate=subtraction_6, YCoordinate=division_4, ZCoordinate=0)  # -> flatten(Point)
vec_24 = VectorXYZ(XComponent=subtraction_6, YComponent="150", ZComponent=0)  # -> Vector, Length
rev_4 = Reverse(Vector=vec_23.Vector)
pline = PolyLine(Vertices=[pt_9, pt_10], Closed=False)
pline_2 = PolyLine(Vertices=[pt_11, pt_5], Closed=False)
arc = ArcSED(Start=pt_10, End=pt_11, Direction=vec_23.Vector)  # -> Arc, Plane, Radius
pline_3 = PolyLine(Vertices=[pt_4, vec_24.Vector], Closed=False)
arc_2 = ArcSED(Start=pt_8, End=pt_9, Direction=rev_4)  # -> Arc, Plane, Radius
pline_4 = PolyLine(Vertices=[pt_7, pt_8], Closed=False)
arc_3 = ArcSED(Start=vec_24.Vector, End=pt_7, Direction=vec_23.Vector)  # -> Arc, Plane, Radius

# ----
# Kühlkanal
# Querschnitt Kühlkanal
# Querschnitt Einlass
panel_18 = Panel("{-8, 150, 0}")
breite_2 = Slider(8, range=1..8)
yz_plane_2 = YZPlane(Origin=panel_18)
eval = Evaluate(F="x*2", x=panel_10)
eval_2 = Evaluate(F="x*2", x=panel_10)
yz_plane_3 = YZPlane(Origin="{10, 150, 0}")
dom = Domain(DomainStart=expr("-x/2", panel_8), DomainEnd=expr("x/2", panel_8))
dom_2 = Domain(DomainStart=expr("-x/2", breite_2), DomainEnd=expr("x/2", breite_2))
dom_3 = Domain(DomainStart=expr("-x/2", eval), DomainEnd=expr("x/2", eval_2))
rectangle_4 = Rectangle(Plane=yz_plane_2, XSize=dom_2, YSize=dom_3, Radius=0)  # -> Rectangle, Length
rectangle_5 = Rectangle(Plane=yz_plane_3, XSize=dom, YSize=dom_3, Radius=0)  # -> Rectangle, Length
construct_point_2 = ConstructPoint(XCoordinate=0, YCoordinate="90", ZCoordinate=0)
loft = Loft(
    Curves=[rectangle_4.Rectangle, rectangle_5.Rectangle],
    Options={Adjust=False, Closed=False, LoftEnds=0, LoftSimp=0, LoftType=0, Rebuild=10, Refit=0.01})
xz_plane = XZPlane(Origin=construct_point_2)
cap_holes_6 = CapHoles(Brep=loft)
mirror_8 = Mirror(Geometry=cap_holes_6, Plane=xz_plane)  # -> Geometry, Transform
solid_union_4 = SolidUnion(Breps=[cap_holes_6, mirror_8.Geometry])
yz_plane_4 = YZPlane(Origin=pt_8)
yz_plane_5 = YZPlane(Origin=pt_7)
yz_plane_6 = YZPlane(Origin=pt_9)
yz_plane_7 = YZPlane(Origin=pt_11)
yz_plane_8 = YZPlane(Origin=pt_8)
yz_plane_9 = YZPlane(Origin=pt_10)
rectangle_6 = Rectangle(Plane=yz_plane_4, XSize=dom, YSize=dom_3, Radius=0)  # -> Rectangle, Length
rectangle_7 = Rectangle(Plane=yz_plane_3, XSize=dom, YSize=dom_3, Radius=0)  # -> Rectangle, Length
rectangle_8 = Rectangle(Plane=yz_plane_5, XSize=dom, YSize=dom_3, Radius=0)  # -> Rectangle, Length
rectangle_9 = Rectangle(Plane=yz_plane_6, XSize=dom, YSize=dom_3, Radius=0)  # -> Rectangle, Length
rectangle_10 = Rectangle(Plane=yz_plane_7, XSize=dom, YSize=dom_3, Radius=0)  # -> Rectangle, Length
rectangle_11 = Rectangle(Plane=yz_plane_8, XSize=dom, YSize=dom_3, Radius=0)  # -> Rectangle, Length
rectangle_12 = Rectangle(Plane=yz_plane_9, XSize=dom, YSize=dom_3, Radius=0)  # -> Rectangle, Length
sweep1 = Sweep1(Rail=pline_3, Sections=rectangle_7.Rectangle, Miter=1)
sweep1_2 = Sweep1(Rail=pline_4, Sections=rectangle_6.Rectangle, Miter=1)
sweep1_3 = Sweep1(Rail=arc_3.Arc, Sections=rectangle_8.Rectangle, Miter=1)
sweep1_4 = Sweep1(Rail=pline, Sections=rectangle_9.Rectangle, Miter=1)
sweep1_5 = Sweep1(Rail=pline_2, Sections=rectangle_10.Rectangle, Miter=1)
sweep1_6 = Sweep1(Rail=arc_2.Arc, Sections=rectangle_11.Rectangle, Miter=1)
sweep1_7 = Sweep1(Rail=arc.Arc, Sections=rectangle_12.Rectangle, Miter=1)
cap_holes_7 = CapHoles(Brep=[sweep1, sweep1_3, sweep1_2, sweep1_6, sweep1_4, sweep1_7, sweep1_5, solid_union_4])
solid_union_5 = SolidUnion(Breps=cap_holes_7)

# ----
# Rippe in Y Lang
number_slider_14 = Slider(1, range=0..1)
pl_offset_2 = PlaneOffset(BasePlane=PlaneXY(0, 0, 0), Offset=addition_9)
addition_10 = Addition(A=panel_5, B=number_slider_14)
series_3 = Series(Start=0, Step=1, Count=addition_10)
number_slider_15 = Slider(46, range=0..100)
rec_2pt_5 = Rectangle2Pt(Plane=pl_offset_2, PointA="{0, 19, 0}", PointB="{3, 161, 0}", Radius=Slider(1, range=0..1))  # -> Rectangle, Length
rec_2pt_6 = Rectangle2Pt(Plane=pl_offset_2, PointA="{12, 164, 0}", PointB="{37, 161, 0}", Radius=Slider(1, range=0..1))  # -> Rectangle, Length
multiplication_6 = Multiplication(A=number_slider_15, B=series_3)
vec_25 = VectorXYZ(XComponent=[multiplication_6, number_slider_15], YComponent=0, ZComponent=0)  # -> Vector, Length
extr_14 = Extrude(Base=rec_2pt_5.Rectangle, Direction="{0, 0, 5}")
cap_12 = CapHoles(Brep=extr_14)
move_5 = Move(Geometry=cap_12, Motion=vec_25.Vector)  # -> Geometry, Transform

# ----
# Rippe in X Kurz
number_slider_16 = Slider(46, range=0..100)
series_4 = Series(Start=0, Step=1, Count=panel_5)
multiplication_7 = Multiplication(A=number_slider_16, B=series_4)
extr_15 = Extrude(Base=rec_2pt_6.Rectangle, Direction="{0, 0, 5}")
vec_26 = VectorXYZ(XComponent=[multiplication_7, number_slider_16], YComponent=0, ZComponent=0)  # -> Vector, Length
cap_13 = CapHoles(Brep=extr_15)
move_6 = Move(Geometry=cap_13, Motion=vec_26.Vector)  # -> Geometry, Transform

# ----
# KISS BATTERY
# Plattenstärke
wandstärke_tiefe_des_kühlkanals = Panel(addition_9)

addition_11 = Addition(A=Slider(-20, range=-20..100), B=addition_9)
addition_12 = Addition(A=Slider(20, range=0..100), B=addition_9)
addition_13 = Addition(A=Slider(12, range=0..100), B=addition_9)
vec_27 = VectorXYZ(XComponent=0, YComponent=0, ZComponent=addition_11)  # -> Vector, Length
vec_28 = VectorXYZ(XComponent=0, YComponent=0, ZComponent=addition_12)  # -> Vector, Length
vec_29 = VectorXYZ(XComponent=0, YComponent=0, ZComponent=addition_13)  # -> Vector, Length
extr_16 = Extrude(Base=[circle_12, circle_9], Direction=vec_29.Vector)
rev_5 = Reverse(Vector=vec_28.Vector)
extr_17 = Extrude(Base=[circle_11, circle_10], Direction=graft([vec_27.Vector, rev_5]))
extr_18 = Extrude(Base=[circle_11, circle_10], Direction=graft([vec_28.Vector, rev_5]))
cap_14 = CapHoles(Brep=extr_16)
cap_15 = CapHoles(Brep=[extr_17, extr_18])
sunion_6 = SolidUnion(Breps=cap_15)  # -> flatten(Result)
sdiff_3 = SolidDifference(BrepsA=cap_14, BrepsB=sunion_6)
mirror_9 = Mirror(Geometry=sdiff_3, Plane=xz_4)  # -> Geometry, Transform
division_5 = Division(A=multiplication_5, B=Slider(2, range=0..10))
vec_30 = VectorXYZ(XComponent=division_5, YComponent=0, ZComponent=0)  # -> Vector, Length
yz_3 = YZPlane(Origin=vec_30.Vector)
mirror_10 = Mirror(Geometry=[mirror_9.Geometry, sdiff_3], Plane=yz_3)  # -> Geometry, Transform

sunion_7 = SolidUnion(Breps=[cap_9, move_5.Geometry, move_6.Geometry])

# ----
# CAD
merge_2 = Merge(Data1=sunion_7, Data2=mirror_10.Geometry, Data3=mirror_9.Geometry, Data5=sdiff_3)
sdiff_4 = SolidDifference(BrepsA=graft(merge_2), BrepsB=flatten([cap_11, solid_union_5]))
panel_19 = Panel(sdiff_4)

custom_preview = CustomPreview(Geometry=sdiff_4, Material=create_material)

# ----
# POUCHZELLEN
number_slider_17 = Slider(-6, range=-20..10)
python = GhPythonScript(x=panel_5)  # -> out, a
# ---------- python: Python ----------
__author__ = "Sebastian"
__version__ = "2021.03.04"

import rhinoscriptsyntax as rs



#print(int(x))
list=range(1, int(x))
#print(list)


for n in list:
    y=n*46.375
    print(y)
# ---------- end python ----------
number_slider_18 = Slider(161, range=0..300)
number_slider_19 = Slider(24.5, range=0..100)
addition_14 = Addition(A=panel_9, B=Slider(6, range=0..10))
panel_20 = Panel(python.out)
addition_15 = Addition(A=addition_13, B=number_slider_17)
matrix = ConstructMatrix(Rows=3, Columns=Slider(1, range=0..1))
multiplication_8 = Multiplication(A=addition_14, B="-1")
vec_31 = VectorXYZ(XComponent=number_slider_19, YComponent=number_slider_18, ZComponent=addition_15)  # -> Vector, Length
vec_32 = VectorXYZ(XComponent=python.out, YComponent=0, ZComponent=0)  # -> Vector, Length
panel_21 = Panel(matrix)
vec_33 = VectorXYZ(XComponent=number_slider_19, YComponent=number_slider_18, ZComponent=multiplication_8)  # -> Vector, Length
brep = Brep(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)
move_7 = Move(Geometry=brep, Motion=vec_31.Vector)  # -> Geometry, Transform
move_8 = Move(Geometry=brep, Motion=vec_33.Vector)  # -> Geometry, Transform
move_9 = Move(Geometry=graft([move_7.Geometry, move_8.Geometry]), Motion=vec_32.Vector)  # -> Geometry, Transform
merge_3 = Merge(Data1=[move_7.Geometry, move_9.Geometry, move_8.Geometry])

# ----
# Cut Out
number_slider_20 = Slider(200, range=0..1000)
number_slider_21 = Slider(50, range=0..1000)
subtraction_7 = Subtraction(A=multiplication_5, B=number_slider_21)
vec_34 = VectorXYZ(XComponent=subtraction_7, YComponent=Slider(168, range=0..1000), ZComponent=0)  # -> Vector, Length
vec_35 = VectorXYZ(XComponent=number_slider_21, YComponent=number_slider_20, ZComponent=0)  # -> Vector, Length
rec_2pt_7 = Rectangle2Pt(Plane=PlaneXY(0, 0, 0), PointA=vec_35.Vector, PointB=vec_34.Vector, Radius=Slider(5, range=0..10))  # -> Rectangle, Length
mirror_11 = Mirror(Geometry=rec_2pt_7.Rectangle, Plane=xz_4)  # -> Geometry, Transform
vec_36 = VectorXYZ(XComponent=0, YComponent=0, ZComponent=Slider(100, range=0..100))  # -> Vector, Length
vec_37 = VectorXYZ(XComponent=0, YComponent=0, ZComponent=Slider(100, range=0..100))  # -> Vector, Length
rev_6 = Reverse(Vector=vec_36.Vector)
extr_19 = Extrude(Base=[mirror_11.Geometry, rec_2pt_7.Rectangle], Direction=graft([rev_6, vec_37.Vector]))
cap_16 = CapHoles(Brep=extr_19)

# ----
# CAD
merge_4 = Merge(Data1=sunion_4, Data2=mirror_4.Geometry, Data3=mirror_3.Geometry, Data5=sdiff)
sdiff_5 = SolidDifference(BrepsA=graft(merge_4), BrepsB=flatten(cap_16))
panel_22 = Panel(sdiff_5)

# ----
# STACK
# Pouchzellen
# Grundplatte mit Kanal
# Grundplatte ohne Kanal
# Abschlussplatte
panel_23 = Panel("Grundplatte ohne Kanal")
panel_24 = Panel("Grundplatte mit Kanal")
addition_16 = Addition(A=addition, B=addition_13)
addition_17 = Addition(A=addition, B=panel_12)
grundplatte_mit_kuehlkanal = Data(sdiff_4)
pouch_zellen = Data(merge_3)
grundplatte_ohne_kuehlkanal = Data(sdiff_2)
abschlussplatte1 = Data(sdiff_5)
vec_38 = VectorXYZ(XComponent=0, YComponent=0, ZComponent=addition_17)  # -> Vector, Length
python_2 = GhPythonScript(x=panel_7, y=addition_16)  # -> out, a
# ---------- python_2: Python ----------
__author__ = "Sebastian"
__version__ = "2021.03.04"

import rhinoscriptsyntax as rs



#print(int(x))
list=range(1, int(x))
#print(list)


for n in list:
    z=n*y
    print(z)
# ---------- end python_2 ----------
rev_7 = Reverse(Vector=vec_38.Vector)
multiplication_9 = Multiplication(A=panel_7, B=addition_16)
move_10 = Move(Geometry=abschlussplatte1, Motion=rev_7)  # -> Geometry, Transform
vec_39 = VectorXYZ(XComponent=0, YComponent=0, ZComponent=python_2.out)  # -> Vector, Length
addition_18 = Addition(A=multiplication_9, B=panel_12)
vec_40 = VectorXYZ(XComponent=0, YComponent=0, ZComponent=addition_18)  # -> Vector, Length
move_11 = Move(Geometry=graft(pouch_zellen), Motion=vec_39.Vector)  # -> Geometry, Transform
move_12 = Move(Geometry=graft(grundplatte_mit_kuehlkanal), Motion=vec_39.Vector)  # -> Geometry, Transform
move_13 = Move(Geometry=graft(grundplatte_ohne_kuehlkanal), Motion=vec_39.Vector)  # -> Geometry, Transform
move_14 = Move(Geometry=move_10.Geometry, Motion=vec_40.Vector)  # -> Geometry, Transform

plane_offset = PlaneOffset(BasePlane=rev_7, Offset=" -0.1")
text_curves = TextCurves(Plane=plane_offset, Text=panel_11, Font=font)
move_15 = Move(Geometry=text_curves, Motion="-48, 11, 0")  # -> Geometry, Transform
boundary_surfaces = BoundarySurfaces(Edges=move_15.Geometry)
extrude_6 = Extrude(Base=boundary_surfaces, Direction=unit_z)
mirror_12 = Mirror(Geometry=extrude_6, Plane=yz_plane)  # -> Geometry, Transform
custom_preview_2 = CustomPreview(Geometry=mirror_12.Geometry, Material=create_material_2)

# ----
# Stacking Verschraubung
panel_25 = Panel("Grundplatte ohne Kanal")
panel_26 = Panel("Abschlussplatte")
addition_19 = Addition(A=addition, B=panel_12)
vector_xyz_7 = VectorXYZ(XComponent=0, YComponent=0, ZComponent=addition_19)  # -> Vector, Length
abschlussplatte1_2 = Data(cap_holes_3)
reverse_4 = Reverse(Vector=vector_xyz_7.Vector)
move_16 = Move(Geometry=abschlussplatte1_2, Motion=reverse_4)  # -> Geometry, Transform
move_17 = Move(Geometry=move_16.Geometry, Motion=vec_39.Vector)  # -> Geometry, Transform
xz_plane_2 = XZPlane(Origin="{0, 90, 0}")
solid_union_6 = SolidUnion(Breps=[move_17.Geometry, move_16.Geometry])
mirror_13 = Mirror(Geometry=solid_union_6, Plane=xz_plane_2)  # -> Geometry, Transform
yz_plane_10 = YZPlane(Origin=vec_5.Vector)
solid_union_7 = SolidUnion(Breps=[solid_union_6, mirror_13.Geometry])
mirror_14 = Mirror(Geometry=solid_union_7, Plane=yz_plane_10)  # -> Geometry, Transform
solid_union_8 = SolidUnion(Breps=[solid_union_7, mirror_14.Geometry])

# ----
# Stacking Mutter Verschraubung
data = Data(solid_union)
move_18 = Move(Geometry=data, Motion=reverse_4)  # -> Geometry, Transform
xz_plane_3 = XZPlane(Origin="{0, 90, 0}")
mirror_15 = Mirror(Geometry=move_18.Geometry, Plane=xz_plane_3)  # -> Geometry, Transform
solid_union_9 = SolidUnion(Breps=[move_18.Geometry, mirror_15.Geometry])
yz_plane_11 = YZPlane(Origin=vec_5.Vector)
mirror_16 = Mirror(Geometry=solid_union_9, Plane=yz_plane_11)  # -> Geometry, Transform
solid_union_10 = SolidUnion(Breps=[solid_union_9, mirror_16.Geometry])

# ----
# Stacking Verschluss Kühlkanal
data_2 = Data(solid_union_2)
move_19 = Move(Geometry=data_2, Motion=reverse_4)  # -> Geometry, Transform
xz_plane_4 = XZPlane(Origin="{0, 90, 0}")
mirror_17 = Mirror(Geometry=move_19.Geometry, Plane=xz_plane_4)  # -> Geometry, Transform
solid_union_11 = SolidUnion(Breps=[move_19.Geometry, mirror_17.Geometry])
mirror_18 = Mirror(Geometry=solid_union_11, Plane=yz_plane_11)  # -> Geometry, Transform
solid_union_12 = SolidUnion(Breps=[solid_union_11, mirror_18.Geometry])

panel_27 = Panel(addition_16)
panel_28 = Panel(rev_7)

# ----
# BMS
number_slider_22 = Slider(1.5, range=0..10)
pi_2 = Pi(Factor=number_slider_22)
yz_4 = YZPlane(Origin=Point(0, 0, 0))
brep_2 = Brep(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)
rot3d_2 = Rotate3D(Geometry=brep_2, Angle=pi_2, Center=Point(0, 0, 0), Axis=yz_4)  # -> Geometry, Transform
vec_41 = VectorXYZ(XComponent=yz_3, YComponent=Slider(131, range=0..200), ZComponent=Slider(-18, range=-50..100))  # -> Vector, Length
move_20 = Move(Geometry=rot3d_2.Geometry, Motion=vec_41.Vector)  # -> Geometry, Transform

pouch_zellen_2 = CustomPreview(Geometry=[move_11.Geometry, merge_3], Material=material)
grundplatte_mit_kanal = CustomPreview(Geometry=[move_12.Geometry, sdiff_4], Material=material_2)
grundplatte_ohne_kanal = CustomPreview(Geometry=[move_13.Geometry, grundplatte_ohne_kuehlkanal], Material=material_3)
bms = CustomPreview(Geometry=move_20.Geometry, Material=material_4)
abschlussplatte_2 = CustomPreview(Geometry=[move_10.Geometry, move_14.Geometry], Material=material_5)
custom_preview_3 = CustomPreview(Geometry=solid_union_8, Material=material_6)
custom_preview_4 = CustomPreview(Geometry=solid_union_12, Material=material_7)
custom_preview_5 = CustomPreview(Geometry=solid_union_10, Material=material_8)
